# Dynamo graph TestReadDefinition.dyn (Dynamo 0.9.1.3096)

code_block = CodeBlock { "C:\Users\mthumfart\Documents\GitHub\SketchUpNET\SketchUp\SketchUpNET\Testfiles\TestModel.skp"; }
loadModel = SketchUpForDynamo.SketchUp.LoadModel(code_block)
getInstance = SketchUpForDynamo.SketchUp.GetInstance(loadModel.out2)
